# Grasshopper definition fullmushroom1.0.gh (Grasshopper 1.0.4)
# plug-ins: LunchBox

# Growth! (use top then bottom)
shape_factor = Slider(1, range=0.43..1)
size_factor = Slider(1, range=0..1)

# ----
# gill-stem connection : steep to smooth (low-high, height)
cap_thickness_at_margin_tip_x = Slider(111, range=80..140)
cap_thickness_at_margin_tip_y = Slider(125, range=50..135)
gill_height = Slider(91, range=20..100)
# gill-curve shape: shallow to steep
gill_peak = Slider(54, range=40..100)

# ----
# bake
bake = BooleanToggle(False)

# ----
# margins curlyness (usually 0.4 and 0.8 are looped)
# cap thickness controls
curlyness = Slider(0.5, range=0..1)
_10_for_serial = Multiplication(A=curlyness, B=10)

# ----
# tilt - if breaks, try a lower number
tilt_my_mushroom = BooleanToggle(False)
amount_of_tilt = Slider(3, range=0..15)

# ----
# cap margins - above or below the stem tip
# (margin tip - above or below gill-stem connection)
# cap - bowl or mount
number_slider = Slider(137, range=60..150)
number_slider_2 = Slider(118, range=20..200)

# ----
# Mushroom height
# stem ratio height
# top section ratio height
# bottom-middle sections ratio height
middle_bottom_ratio = Slider(50, range=0..100)
percentege_for_stem = Slider(49, range=0..100)
top_section = Slider(66, range=0..100)
height = Slider(26, range=5..100)

# ----
# stem width
# top section width
# middle section width
# bottom section width
# bottom trim width
number_slider_3 = Slider(12, range=3..60)
number_slider_4 = Slider(11, range=0..100)
number_slider_5 = Slider(4, range=0..50)
number_slider_6 = Slider(33, range=0..100)
number_slider_7 = Slider(59, range=0..100)

# ----
# cap width
# cap steepness (outer) width
# cap - bowl-mount smoothness
# margin tip - from cap width max point
vs_cap_center = Slider(36, range=20..70)
number_slider_8 = Slider(74, range=0..100)
number_slider_9 = Slider(17, range=15..120)

# ----
# Width
min_of_cap_width_is_stem_width = Subtraction(A=number_slider_9, B=0)
evaluate = Evaluate(F="( maxVal * percentage ) / 100", maxVal=min_of_cap_width_is_stem_width, percentage=number_slider_8)
margin_tip_x = Evaluate(F="( maxVal * percentage ) / 100", maxVal=min_of_cap_width_is_stem_width, percentage=Slider(58, range=10..80))
evaluate_2 = Evaluate(F="( maxVal * percentage ) / 100", maxVal=number_slider_3, percentage=number_slider_4)
evaluate_3 = Evaluate(F="( maxVal * percentage ) / 100", maxVal=number_slider_3, percentage=number_slider_6)
evaluate_4 = Evaluate(F="( maxVal * percentage ) / 100", maxVal=number_slider_3, percentage=number_slider_7)
cir = Circle(Plane=PlaneXY(0, 0, 0), Radius=number_slider_5)
evaluate_5 = Evaluate(F="( maxVal * percentage ) / 100", maxVal=evaluate, percentage=vs_cap_center)

# ----
# Height
top_of_stem = Evaluate(F="( maxVal * percentage ) / 100", maxVal=height, percentage=percentege_for_stem)
subtraction = Subtraction(_100=100, B=top_section)
middle_of_stem = Evaluate(F="( maxVal * percentage ) / 100", maxVal=top_of_stem, percentage=subtraction)
cap_height = Subtraction(A=height, B=top_of_stem)
eval = Evaluate(F="( maxVal * percentage ) / 100", maxVal=height, percentage=number_slider)
margin_height = Evaluate(F="( maxVal * percentage ) / 100", maxVal=top_of_stem, percentage=number_slider_2)
bottom_of_stem = Evaluate(F="( maxVal * percentage ) / 100", maxVal=middle_of_stem, percentage=middle_bottom_ratio)

# ----
# serial
concat = Concatenate(
    A=height,
    B=percentege_for_stem,
    C=top_section,
    D=middle_bottom_ratio,
    separator1=";",
    E=number_slider_2,
    F=number_slider,
    G=number_slider_9,
    H=number_slider_8,
    separator2=";",
    I=vs_cap_center,
    J=number_slider_3,
    K=number_slider_4,
    L=number_slider_6,
    separator3=";",
    M=number_slider_7,
    N=number_slider_5,
    O=_10_for_serial,
    P=gill_height,
    separator4=";",
    Q=gill_peak,
    R=cap_thickness_at_margin_tip_x,
    S=cap_thickness_at_margin_tip_y,
    separator5=";",
    T=amount_of_tilt,
    U=shape_factor,
    V=size_factor)
serial_no_hex_calculator = SerialNoHexCalculator(T=concat)  # -> cleanserial, hex, lengths
panel = Panel(serial_no_hex_calculator.hex)
tag = TextTag3D(Location=PlaneXZ(6.031942831, 0, -4.103698811), Text=serial_no_hex_calculator.hex, Size=1, Justification=7)
unhex = UnHex(hex=serial_no_hex_calculator.hex, int=serial_no_hex_calculator.lengths)
panel_2 = Panel(unhex)

# ----
# gill-stem connection control points
min_point_of_cap = Minimum(A=eval, B=height)
gill_stem_connection_x = Evaluate(F="( maxVal * percentage ) / 100", maxVal=margin_height, percentage=gill_peak)
gill_stem_connection_z = Evaluate(F="( maxVal * percentage ) / 100", maxVal=min_point_of_cap, percentage=gill_height)
gill_cap_inner_connection_x = Evaluate(F="( maxVal * percentage ) / 100", maxVal=margin_tip_x, percentage=cap_thickness_at_margin_tip_x)
gill_cap_inner_connection_z = Evaluate(F="( maxVal * percentage ) / 100", maxVal=top_of_stem, percentage=cap_thickness_at_margin_tip_y)
pt = ConstructPoint(XCoordinate=gill_cap_inner_connection_x, YCoordinate=0, ZCoordinate=gill_cap_inner_connection_z)
pt_2 = ConstructPoint(XCoordinate=gill_stem_connection_x, YCoordinate=0, ZCoordinate=gill_stem_connection_z)

# ----
# Archimedes' spiral
# Margins Curl
archimedes = Archimedes(A_2=margin_tip_x, N=curlyness, A_4=curlyness, A=_10_for_serial, A_3=margin_height)

# ----
# stem control points
top_section_2 = ConstructPoint(XCoordinate=evaluate_2, YCoordinate=0, ZCoordinate=top_of_stem)
mid_section = ConstructPoint(XCoordinate=evaluate_3, YCoordinate=0, ZCoordinate=middle_of_stem)
bottom_section = ConstructPoint(XCoordinate=evaluate_4, YCoordinate=0, ZCoordinate=bottom_of_stem)
bottom_trim = ConstructPoint(XCoordinate=number_slider_5, YCoordinate=0, ZCoordinate=0)

# ----
# curlyness control points
curly_outer = ListItem(List=archimedes, Index=2, Wrap=True)
curly_middle = ListItem(List=archimedes, Index=1, Wrap=True)
curly_inner = ListItem(List=archimedes, Index=0, Wrap=True)

# ----
# margin tip control point
pt_3 = ConstructPoint(XCoordinate=margin_tip_x, YCoordinate=0, ZCoordinate=margin_height)

# ----
# cap control points
cap_top_tip = ConstructPoint(XCoordinate=0, YCoordinate=0, ZCoordinate=height)
cap_bowl_smoothness = ConstructPoint(XCoordinate=evaluate_5, YCoordinate=0, ZCoordinate=height)
steepness_min_width = ConstructPoint(XCoordinate=evaluate, YCoordinate=0, ZCoordinate=eval)
max_width = ConstructPoint(XCoordinate=min_of_cap_width_is_stem_width, YCoordinate=0, ZCoordinate=margin_height)

growth_factor = GrowthFactor(
    G_9=cap_top_tip,
    G_10=cap_bowl_smoothness,
    G_4=steepness_min_width,
    G_8=max_width,
    G_2=curly_outer,
    num=shape_factor,
    G=curly_middle,
    G_3=curly_inner,
    G_5=pt_3,
    G_6=pt,
    G_7=pt_2)  # -> G_15, G_17, G_11, G_14, G_18, G_16, G_19, G_20, G_12, G_13

cap_bottom_points = Merge(Data1=growth_factor.G_20, Data2=growth_factor.G_12, Data3=growth_factor.G_13)
top_of_cap_points = Merge(Data1=growth_factor.G_15, Data2=growth_factor.G_17, Data3=growth_factor.G_11, Data4=growth_factor.G_14)
curl_points = Merge(Data1=growth_factor.G_18, Data2=growth_factor.G_16, Data3=growth_factor.G_19)  # -> flatten(Result)
stem_points = Merge(Data1=top_section_2, Data2=mid_section, Data3=bottom_section, Data4=bottom_trim)
merge = Merge(Data1=curl_points, Data2=growth_factor.G_20)  # -> flatten(Result)

# ----
# Tilt the Bake
panel_3 = Panel(height)
cluster = Cluster(C=panel_3, send=tilt_my_mushroom, A=amount_of_tilt, B=panel_3)

# ----
# OneCurve
merge_2 = Merge(Data1=top_of_cap_points, Data2=curl_points, Data3=cap_bottom_points, Data4=stem_points)
nurbs = NurbsCurve(Vertices=merge_2, Degree=3, Periodic=False)  # -> Curve, Length, Domain
ln = Line(StartPoint=cap_top_tip, EndPoint=Point(0, 0, 0))
gills = Gills(C=nurbs.Curve, A=cap_height, A_2=growth_factor.G_15, B=top_section_2)  # -> C_2, gill_curve_4, C_3, gill_curve_5, R
revsrf = Revolution(Curve=nurbs.Curve, Axis=ln, Domain=Domain(0, 6.283185307))

# ----
# merge and order surfaces
splitting_circles = Merge(Data1=gills.C_2, Data2=gills.C_3)
srfsplit = SurfaceSplit(Surface=revsrf, Curves=splitting_circles)
stem = ListItem(List=srfsplit, Index=1, Wrap=True)
cap = ListItem(List=srfsplit, Index=0, Wrap=True)
rulesrf = RuledSurface(CurveA=gills.gill_curve_4, CurveB=gills.C_2)
gills_2 = Loft(Curves=gills.R, Options={Adjust=False, Closed=False, LoftEnds=0, LoftSimp=0, LoftType=0, Rebuild=10, Refit=0.01})
rulesrf_2 = RuledSurface(CurveA=gills.gill_curve_5, CurveB=gills.C_3)
merge_3 = Merge(Data1=cap, Data2=rulesrf, Data3=gills_2, Data4=rulesrf_2, Data5=stem)
brepjoin = BrepJoin(Breps=merge_3)  # -> Breps, Closed

# ----
# Mushroom Object
brepmushroom = CapHoles(Brep=brepjoin.Breps)
scale = Scale(Geometry=brepmushroom, Center=Point(0, 0, 0), Factor=size_factor)  # -> Geometry, Transform
bake_2 = ObjectBake(
    BakeToggle=bake,
    GeometryObjects=scale.Geometry,
    Layer="GH_Bake",
    ObjectName="GH_Obj",
    ObjectColor=RGB(255, 255, 255),
    LayerColor=RGB(255, 255, 255))

# ==== cluster Cluster
fragment_a = FragmentA("0,")
C = ClusterInput()
A = ClusterInput()
B = ClusterInput()
concat = Concatenate(FragmentA=fragment_a, FragmentB=fragment_a, FragmentC=C)
concat_2 = Concatenate(FragmentA=A, FragmentD=",0,", FragmentB=B)
panel = Panel(",0 ")
concat_3 = Concatenate(FragmentA="'_SelNone '_SelPolysrf Bend 0 ", FragmentC=concat, FragmentE=" ", FragmentD=concat_2, FragmentB=" Enter")
panel_2 = Panel(concat_3)
send = ClusterInput()
rhcom = RhinoCommand(SendCommandToggle=send, CommandString=panel_2)

# ==== cluster Archimedes
A = ClusterInput()
N = ClusterInput()
multiplication = Multiplication(A=A, B=2.718281828)
series = Series(Start=1, Step=N, Count=multiplication)
expression = Expression(t=series, Expression="t*cos(t)")
expression_2 = Expression(t=series, Expression="t*sin(t)")
A_2 = ClusterInput()
A_3 = ClusterInput()
margin_tip_x = Addition(A=A_2, B=expression)
margin_tip_z = Addition(A=A_3, B=expression_2)
pt = ConstructPoint(XCoordinate=margin_tip_x, YCoordinate=0, ZCoordinate=margin_tip_z)
curve_from_points = Interpolate(Vertices=pt, Degree=3, Periodic=False, KnotStyle=1)  # -> Curve, Length, Domain
A_4 = ClusterInput()
division = Division(A=A_4, B=Slider(7, range=0..10))
_3_points_of_curlyness = Integer(3)
series_2 = Series(Start=0.1, Step=division, Count=_3_points_of_curlyness)
panel = Panel(series_2)
eval = EvaluateCurve(Curve=reparameterize(curve_from_points.Curve), Parameter=series_2)  # -> Point, Tangent, Angle
P = ClusterOutput(eval.Point)

# ==== cluster SerialNoHexCalculator
T = ClusterInput()
rep = ReplaceText(Text=T, Find=".0", RecursiveReplace=False)
panel = Panel(rep)
cleanserial = ClusterOutput(rep)
split = TextSplit(Text=panel, Separators=";")
item = ListItem(List=split, Index=0, Wrap=True)
item_2 = ListItem(List=split, Index=1, Wrap=True)
item_3 = ListItem(List=split, Index=2, Wrap=True)
item_4 = ListItem(List=split, Index=4, Wrap=True)
item_5 = ListItem(List=split, Index=5, Wrap=True)
c_script = CSharpScript(x=item)  # -> out, A
# ---------- c_script: C# ----------
                                                //Reflect(x);

// Convert grasshopper object to string
string strX = x.ToString();

// Store integer x
int intValueX = Convert.ToInt32(strX);
//A = intValueX;

// Convert integer x as a hex in a string variable
string hexValue = intValueX.ToString("X");
A =hexValue;

return;
# ---------- c_script: C# additional code ----------
  //Return a BoundingBox that contains all the geometry you are about to draw.
  public override BoundingBox ClippingBox
  {
    get
    {
      return BoundingBox.Empty;
    }
  }

  //Draw all meshes in this method.
  public override void DrawViewportMeshes(IGH_PreviewArgs args)
  {
  }

  //Draw all wires and points in this method.
  public override void DrawViewportWires(IGH_PreviewArgs args)
  {
  }



  /// <summary>
  /// This method will be called once every solution, before any calls to RunScript.
  /// </summary>
  public override void BeforeRunScript()
  { }
  /// <summary>
  /// This method will be called once every solution, after any calls to RunScript.
  /// </summary>
  public override void AfterRunScript()
  { }
# ---------- end c_script ----------
c_script_2 = CSharpScript(x=c_script.A)  # -> out, A
# ---------- c_script_2: C# ----------
                                                        //Reflect(x);

// Convert from hex to int
string hexValue = x.ToString();

int intAgain = int.Parse(hexValue, System.Globalization.NumberStyles.HexNumber);
A = intAgain;

return;
# ---------- c_script_2: C# additional code ----------
  //Return a BoundingBox that contains all the geometry you are about to draw.
  public override BoundingBox ClippingBox
  {
    get
    {
      return BoundingBox.Empty;
    }
  }

  //Draw all meshes in this method.
  public override void DrawViewportMeshes(IGH_PreviewArgs args)
  {
  }

  //Draw all wires and points in this method.
  public override void DrawViewportWires(IGH_PreviewArgs args)
  {
  }



  /// <summary>
  /// This method will be called once every solution, before any calls to RunScript.
  /// </summary>
  public override void BeforeRunScript()
  { }
  /// <summary>
  /// This method will be called once every solution, after any calls to RunScript.
  /// </summary>
  public override void AfterRunScript()
  { }
# ---------- end c_script_2 ----------
c_script_3 = CSharpScript(x=item_2)  # -> out, A
# ---------- c_script_3: C# ----------
                                                    //Reflect(x);

// Convert grasshopper object to string
string strX = x.ToString();

// Store integer x
int intValueX = Convert.ToInt32(strX);
//A = intValueX;

// Convert integer x as a hex in a string variable
string hexValue = intValueX.ToString("X");
A =hexValue;

return;
# ---------- c_script_3: C# additional code ----------
  //Return a BoundingBox that contains all the geometry you are about to draw.
  public override BoundingBox ClippingBox
  {
    get
    {
      return BoundingBox.Empty;
    }
  }

  //Draw all meshes in this method.
  public override void DrawViewportMeshes(IGH_PreviewArgs args)
  {
  }

  //Draw all wires and points in this method.
  public override void DrawViewportWires(IGH_PreviewArgs args)
  {
  }



  /// <summary>
  /// This method will be called once every solution, before any calls to RunScript.
  /// </summary>
  public override void BeforeRunScript()
  { }
  /// <summary>
  /// This method will be called once every solution, after any calls to RunScript.
  /// </summary>
  public override void AfterRunScript()
  { }
# ---------- end c_script_3 ----------
c_script_4 = CSharpScript(x=item_3)  # -> out, A; same code as c_script_3
c_script_5 = CSharpScript(x=item_4)  # -> out, A; same code as c_script_3
c_script_6 = CSharpScript(x=item_5)  # -> out, A; same code as c_script_3
len = TextLength(Text=c_script.A)
len_2 = TextLength(Text=c_script_3.A)
len_3 = TextLength(Text=c_script_4.A)
len_4 = TextLength(Text=c_script_5.A)
len_5 = TextLength(Text=c_script_6.A)
ins = InsertItems(List=len, Item=len_2, Indices=1, Wrap=True)
ins_2 = InsertItems(List=ins, Item=len_3, Indices=2, Wrap=True)
ins_3 = InsertItems(List=ins_2, Item=len_4, Indices=3, Wrap=True)
ins_4 = InsertItems(List=ins_3, Item=len_5, Indices=4, Wrap=True)  # -> flatten(Lengths)
panel_2 = Panel(ins_4)
concat = Concatenate(FragmentA=c_script.A, FragmentB=c_script_3.A, FragmentC=c_script_4.A, FragmentD=c_script_5.A, FragmentE=c_script_6.A)
lengths = ClusterOutput(ins_4)
hex = ClusterOutput(concat)

# ==== cluster GrowthFactor
num = ClusterInput()
num_2 = Number(num)
expression = Expression(x=num_2, Expression="x^⅓")
sqr = Square(Value=num_2)
G = ClusterInput()
G_2 = ClusterInput()
G_3 = ClusterInput()
G_4 = ClusterInput()
G_5 = ClusterInput()
G_6 = ClusterInput()
G_7 = ClusterInput()
G_8 = ClusterInput()
G_9 = ClusterInput()
G_10 = ClusterInput()
scale = Scale(Geometry=G, Center=Point(0, 0, 0), Factor=expr("x^2", num_2))  # -> Geometry, Transform
scale_2 = Scale(Geometry=G_2, Center=Point(0, 0, 0), Factor=expr("x^2", num_2))  # -> Geometry, Transform
scale_3 = Scale(Geometry=G_3, Center=Point(0, 0, 0), Factor=expr("x^2", num_2))  # -> Geometry, Transform
scale_4 = Scale(Geometry=G_4, Center=Point(0, 0, 0), Factor=num_2)  # -> Geometry, Transform
scale_5 = Scale(Geometry=G_5, Center=Point(0, 0, 0), Factor=expr("x^2", num_2))  # -> Geometry, Transform
scale_6 = Scale(Geometry=G_6, Center=Point(0, 0, 0), Factor=num_2)  # -> Geometry, Transform
scale_7 = Scale(Geometry=G_7, Center=Point(0, 0, 0), Factor=num_2)  # -> Geometry, Transform
scale_8 = Scale(Geometry=G_8, Center=Point(0, 0, 0), Factor=sqr)  # -> Geometry, Transform
scale_9 = Scale(Geometry=G_9, Center=Point(0, 0, 0), Factor=expression)  # -> Geometry, Transform
scale_10 = Scale(Geometry=G_10, Center=Point(0, 0, 0), Factor=expression)  # -> Geometry, Transform
G_11 = ClusterOutput(scale_4.Geometry)
G_12 = ClusterOutput(scale_6.Geometry)
G_13 = ClusterOutput(scale_7.Geometry)
G_14 = ClusterOutput(scale_8.Geometry)
G_15 = ClusterOutput(scale_9.Geometry)
G_16 = ClusterOutput(scale.Geometry)
G_17 = ClusterOutput(scale_10.Geometry)
G_18 = ClusterOutput(scale_2.Geometry)
G_19 = ClusterOutput(scale_3.Geometry)
G_20 = ClusterOutput(scale_5.Geometry)

# ==== cluster Gills
A = ClusterInput()
A_2 = ClusterInput()
B = ClusterInput()
C = ClusterInput()

dom = ConstructDomain(DomainStart=Slider(5.648, range=0..10), DomainEnd=Slider(9.02, range=0..10))
subcrv = SubCurve(BaseCurve=C, Domain=dom)

curvepoint = PointOnCurve(subcrv, parameter=1)
curvepoint_2 = PointOnCurve(subcrv, parameter=0)
curvepoint_3 = PointOnCurve(subcrv, parameter=0.536)

number_slider = Slider(0.603, range=0..1)

# ----
# gills as point on curve
gill_density = Slider(102, range=0..200)
gill_height_based_on_cap_height = Division(A=A, B=7)
dist = Distance(PointA=A_2, PointB=B)  # -> expr("x/9", Distance)
min = Minimum(A=gill_height_based_on_cap_height, B=dist)

pdecon = Deconstruct(Point=curvepoint_2)  # -> XComponent, YComponent, ZComponent
pt = ConstructPoint(XCoordinate=0, YCoordinate=0, ZCoordinate=pdecon.ZComponent)
xy = XYPlane(Origin=pt)
cir = Circle(Plane=xy, Radius=pdecon.XComponent)
gill_curve = GillCurve(crv=cir, gill_height=min, gill_density=gill_density, N=number_slider)

pdecon_2 = Deconstruct(Point=curvepoint_3)  # -> XComponent, YComponent, ZComponent
pt_2 = ConstructPoint(XCoordinate=0, YCoordinate=0, ZCoordinate=pdecon_2.ZComponent)
xy_2 = XYPlane(Origin=pt_2)
cir_2 = Circle(Plane=xy_2, Radius=pdecon_2.XComponent)
gill_curve_2 = GillCurve(crv=cir_2, gill_height=min, gill_density=gill_density, N=number_slider)

pdecon_3 = Deconstruct(Point=curvepoint)  # -> XComponent, YComponent, ZComponent
pt_3 = ConstructPoint(XCoordinate=0, YCoordinate=0, ZCoordinate=pdecon_3.ZComponent)
xy_3 = XYPlane(Origin=pt_3)
cir_3 = Circle(Plane=xy_3, Radius=pdecon_3.XComponent)
gill_curve_3 = GillCurve(crv=cir_3, gill_height=min, gill_density=gill_density, N=Slider(0.045, range=0.02..1))

C_2 = ClusterOutput(cir)
C_3 = ClusterOutput(cir_3)
gill_curve_4 = ClusterOutput(gill_curve)
gill_curve_5 = ClusterOutput(gill_curve_3)

merge = Merge(Data1=gill_curve, Data2=gill_curve_2, Data3=gill_curve_3)

R = ClusterOutput(merge)

# ==== cluster UnHex
int = ClusterInput()
hex = ClusterInput()
int_2 = Integer(int)
rep = ReplaceText(Text=hex, Find=".0", RecursiveReplace=False)  # -> flatten(Result)
addition = Addition(A=0)
item = ListItem(List=int_2, Index=0, Wrap=False)
addition_2 = Addition(A=addition, B=item)
item_2 = ListItem(List=int_2, Index=2, Wrap=False)
item_3 = ListItem(List=int_2, Index=1, Wrap=False)
addition_3 = Addition(A=addition_2, B=item_3)
addition_4 = Addition(A=addition_3, B=item_2)
item_4 = ListItem(List=int_2, Index=3, Wrap=False)
addition_5 = Addition(A=item_4, B=addition_4)
item_5 = ListItem(List=int_2, Index=4, Wrap=False)
panel = Panel(rep)
fragment = TextFragment(Text=rep, Start=addition, Count=item)
fragment_2 = TextFragment(Text=rep, Start=addition_2, Count=item_3)
fragment_3 = TextFragment(Text=rep, Start=addition_4, Count=item_4)
fragment_4 = TextFragment(Text=rep, Start=addition_5, Count=item_5)
fragment_5 = TextFragment(Text=rep, Start=addition_3, Count=item_2)
panel_2 = Panel(fragment_2)
panel_3 = Panel(fragment)
panel_4 = Panel(fragment_5)
panel_5 = Panel(fragment_3)
panel_6 = Panel(fragment_4)
c_script = CSharpScript(x=fragment)  # -> out, A
# ---------- c_script: C# ----------
    //Reflect(x);

    // Convert from hex to int
    string hexValue = x.ToString();

    int intAgain = int.Parse(hexValue, System.Globalization.NumberStyles.HexNumber);
    A = intAgain;

    return;
# ---------- c_script: C# additional code ----------
  //Return a BoundingBox that contains all the geometry you are about to draw.
  public override BoundingBox ClippingBox
  {
    get
    {
      return BoundingBox.Empty;
    }
  }

  //Draw all meshes in this method.
  public override void DrawViewportMeshes(IGH_PreviewArgs args)
  {
  }

  //Draw all wires and points in this method.
  public override void DrawViewportWires(IGH_PreviewArgs args)
  {
  }



  /// <summary>
  /// This method will be called once every solution, before any calls to RunScript.
  /// </summary>
  public override void BeforeRunScript()
  { }
  /// <summary>
  /// This method will be called once every solution, after any calls to RunScript.
  /// </summary>
  public override void AfterRunScript()
  { }
# ---------- end c_script ----------
c_script_2 = CSharpScript(x=fragment_2)  # -> out, A; same code as c_script_2
c_script_3 = CSharpScript(x=fragment_5)  # -> out, A; same code as c_script_2
c_script_4 = CSharpScript(x=fragment_4)  # -> out, A; same code as c_script
c_script_5 = CSharpScript(x=fragment_3)  # -> out, A; same code as c_script_2
concat = Concatenate(FragmentA=c_script.A, FragmentB=c_script_2.A, FragmentC=c_script_3.A, FragmentD=c_script_5.A, FragmentE=c_script_4.A)
int_3 = ClusterOutput(concat)

# ==== cluster GillCurve
crv = ClusterInput()
gill_density = ClusterInput()
gill_height = ClusterInput()
crv_2 = Curve(crv)
division = Division(GillDensity=gill_density, B=2)
reb = RebuildCurve(Curve=crv_2, GillDensity=gill_density, Tangents=False)
round = Round(Number=division)  # -> Nearest, Floor, Ceiling
cp = ControlPoints(Curve=reb)  # -> Points, Weights, Knots
addition = Addition(A=round.Ceiling, B=1)
series = Series(Start=0, Step=2, Count=addition)
concat = Concatenate(FragmentA="0,0,", GillHeight=gill_height)
item = ListItem(List=cp.Points, Index=series, Wrap=True)
vec2pt = Vector2Pt(PointA=Point(0, 0, 0), PointB=concat, Unitize=False)  # -> Vector, Length
series_2 = Series(Start=1, Step=2, Count=addition)
move = Move(Geometry=item, Motion=vec2pt.Vector)  # -> Geometry, Transform
item_2 = ListItem(List=cp.Points, Index=series_2, Wrap=True)
path_mapper = PathMapper(move.Geometry, source="{a;b}", target="{a}")
shift = ShiftList(List=item_2, Shift=-1, Wrap=False)
path_mapper_2 = PathMapper(shift, source="{a;b;c}", target="{a}")
series_3 = Series(Start=1, Step=1, Count=round.Ceiling)
path_mapper_3 = PathMapper(series_3, source="{a;b}", target="{a}")
ins = InsertItems(List=path_mapper, Item=path_mapper_2, Indices=path_mapper_3, Wrap=False)
path_mapper_4 = PathMapper(ins, source="{a;b}", target="{a}")
tag = TextTag(Location=ins, Text=ins, Colour=RGB(27, 245, 255))
panel = Panel(path_mapper_4)
number_slider = Slider(0.751, range=0..1)
N = ClusterInput()
cluster = Cluster_2(pt=panel, N=N, B=N)
intcrv = Interpolate(Vertices=cluster, Degree=3, Periodic=False, KnotStyle=1)  # -> GillCurve, Length, Domain
gill_curve = ClusterOutput(intcrv.GillCurve)

# ==== cluster Cluster_2
B = ClusterInput()
N = ClusterInput()
subtraction = Subtraction(A=0, B=B)
pt = ClusterInput()
bnd = Bounds(Numbers=[subtraction, N])
pt_2 = Point(pt)
lng = ListLength(List=pt_2)
random = Random(Range=bnd, Number=lng, Seed=3)
random_2 = Random(Range=bnd, Number=lng, Seed=4)
random_3 = Random(Range=bnd, Number=lng, Seed=2)
pt_3 = ConstructPoint(XCoordinate=random_3, YCoordinate=random, ZCoordinate=random_2)
move = Move(Geometry=pt_2, Motion=pt_3)  # -> Geometry, Transform
G = ClusterOutput(move.Geometry)
