# Grasshopper definition fullmushroom2.1.gh (Grasshopper 1.0.4)
# plug-ins: Python Interpreter, LunchBox

# ----
# cap margins - above or below the stem tip
# (margin tip - above or below gill-stem connection)
# cap - bowl or mount
number_slider = Slider(66, range=60..150)
number_slider_2 = Slider(52, range=20..200)

vs_cap_center = Slider(70, range=20..70)
# cap - bowl-mount smoothness
number_slider_3 = Slider(84, range=0..100)
# cap width
# cap steepness (outer) width
number_slider_4 = Slider(17, range=15..120)
# Growth! (use top then bottom)
shape_factor = Slider(1, range=0.43..1)
size_factor = Slider(1, range=0..1)

# ----
# gill-stem connection : steep to smooth (low-high, height)
cap_thickness_at_margin_tip_x = Slider(100, range=80..140)
cap_thickness_at_margin_tip_y = Slider(84, range=50..135)
gill_height = Slider(69, range=20..100)
# gill-curve shape: shallow to steep
gill_peak = Slider(72, range=40..100)

# ----
# bake
bake = BooleanToggle(False)

# ----
# margins curlyness (usually 0.4 and 0.8 are looped)
# cap thickness controls
curlyness = Slider(0.5, range=0..1)
_10_for_serial = Multiplication(A=curlyness, B=10)

# ----
# tilt - if breaks, try a lower number
tilt_my_mushroom = BooleanToggle(False)
amount_of_tilt = Slider(5, range=0..15)

# ----
# stem ratio height
# top section ratio height
# bottom-middle sections ratio height
middle_bottom_ratio = Slider(8, range=0..100)
percentege_for_stem = Slider(58, range=0..100)
top_section = Slider(79, range=0..100)

# ----
# margin tip - from cap width max point
number_slider_5 = Slider(80, range=10..100)
# Mushroom height
height = Slider(30, range=5..100)

# ----
# stem width
# top section width
# middle section width
# bottom section width
# bottom trim width
number_slider_6 = Slider(22, range=3..60)
number_slider_7 = Slider(0, range=0..100)
number_slider_8 = Slider(3, range=0..50)
number_slider_9 = Slider(41, range=0..100)
number_slider_10 = Slider(22, range=0..100)

min_of_cap_width_is_stem_width = Subtraction(A=number_slider_4, B=0)
evaluate = Evaluate(F="( maxVal * percentage ) / 100", maxVal=min_of_cap_width_is_stem_width, percentage=number_slider_3)
margin_tip_x = Evaluate(F="( maxVal * percentage ) / 100", maxVal=min_of_cap_width_is_stem_width, percentage=number_slider_5)
evaluate_2 = Evaluate(F="( maxVal * percentage ) / 100", maxVal=evaluate, percentage=vs_cap_center)
subtraction = Subtraction(_100=100, B=top_section)
top_of_stem = Evaluate(F="( maxVal * percentage ) / 100", maxVal=height, percentage=percentege_for_stem)
evaluate_3 = Evaluate(F="( maxVal * percentage ) / 100", maxVal=number_slider_6, percentage=number_slider_7)
evaluate_4 = Evaluate(F="( maxVal * percentage ) / 100", maxVal=number_slider_6, percentage=number_slider_9)
evaluate_5 = Evaluate(F="( maxVal * percentage ) / 100", maxVal=number_slider_6, percentage=number_slider_10)
cir = Circle(Plane=PlaneXY(0, 0, 0), Radius=number_slider_8)
middle_of_stem = Evaluate(F="( maxVal * percentage ) / 100", maxVal=top_of_stem, percentage=subtraction)
cap_height = Subtraction(A=height, B=top_of_stem)
margin_height = Evaluate(F="( maxVal * percentage ) / 100", maxVal=top_of_stem, percentage=number_slider_2)
eval = Evaluate(F="( maxVal * percentage ) / 100", maxVal=height, percentage=number_slider)
bottom_of_stem = Evaluate(F="( maxVal * percentage ) / 100", maxVal=middle_of_stem, percentage=middle_bottom_ratio)

# ----
# serial
concat = Concatenate(
    A=height,
    B=percentege_for_stem,
    C=top_section,
    D=middle_bottom_ratio,
    separator1=";",
    E=number_slider_2,
    F=number_slider,
    G=number_slider_4,
    H=number_slider_3,
    separator2=";",
    I=vs_cap_center,
    J=number_slider_6,
    K=number_slider_7,
    L=number_slider_9,
    separator3=";",
    M=number_slider_10,
    N=number_slider_8,
    O=_10_for_serial,
    P=gill_height,
    separator4=";",
    Q=gill_peak,
    R=cap_thickness_at_margin_tip_x,
    S=cap_thickness_at_margin_tip_y,
    separator5=";",
    T=amount_of_tilt,
    U=shape_factor,
    V=size_factor)
serial_no_hex_calculator = SerialNoHexCalculator(T=concat)  # -> cleanserial, hex
panel = Panel(serial_no_hex_calculator.hex)
tag = TextTag3D(Location=PlaneXZ(6.031942831, 0, -4.103698811), Text=serial_no_hex_calculator.hex, Size=1, Justification=7)  # disabled

sliders_data = ReplaceText(Text=concat, Find=".0", Replace=";", RecursiveReplace=False)
panel_2 = Panel(sliders_data)
desired_file_extension = Panel("txt")
# mac
file_name = Panel("/Users/rony/Desktop")
file_name_2 = Panel("/Gills_")
# windows
file_name_3 = Panel("C:\Users\rony.ginosar\Desktop")
file_name_4 = Panel("\Gills_")

# ----
# gill-stem connection control points
min_point_of_cap = Minimum(A=eval, B=height)
gill_stem_connection_x = Evaluate(F="( maxVal * percentage ) / 100", maxVal=margin_tip_x, percentage=gill_peak)
gill_stem_connection_z = Evaluate(F="( maxVal * percentage ) / 100", maxVal=min_point_of_cap, percentage=gill_height)
gill_cap_inner_connection_x = Evaluate(F="( maxVal * percentage ) / 100", maxVal=margin_tip_x, percentage=cap_thickness_at_margin_tip_x)
gill_cap_inner_connection_z = Evaluate(F="( maxVal * percentage ) / 100", maxVal=top_of_stem, percentage=cap_thickness_at_margin_tip_y)
pt = ConstructPoint(XCoordinate=gill_cap_inner_connection_x, YCoordinate=0, ZCoordinate=gill_cap_inner_connection_z)
pt_2 = ConstructPoint(XCoordinate=gill_stem_connection_x, YCoordinate=0, ZCoordinate=gill_stem_connection_z)

concat_2 = Concatenate(dir=file_name, prefix=file_name_2, hex=serial_no_hex_calculator.hex)

# ----
# Archimedes' spiral
# Margins Curl
archimedes = Archimedes(A_2=margin_tip_x, N=curlyness, A_4=curlyness, A=_10_for_serial, A_3=margin_height)

ext = FileName(".3dm")
concat_3 = Concatenate(FragmentD=serial_no_hex_calculator.hex, FragmentE=ext)

# ----
# stem control points
top_section_2 = ConstructPoint(XCoordinate=evaluate_3, YCoordinate=0, ZCoordinate=top_of_stem)
mid_section = ConstructPoint(XCoordinate=evaluate_4, YCoordinate=0, ZCoordinate=middle_of_stem)
bottom_section = ConstructPoint(XCoordinate=evaluate_5, YCoordinate=0, ZCoordinate=bottom_of_stem)
bottom_trim = ConstructPoint(XCoordinate=number_slider_8, YCoordinate=0, ZCoordinate=0)

# ----
# curlyness control points
curly_outer = ListItem(List=archimedes, Index=2, Wrap=True)
curly_middle = ListItem(List=archimedes, Index=1, Wrap=True)
curly_inner = ListItem(List=archimedes, Index=0, Wrap=True)

# ----
# margin tip control point
pt_3 = ConstructPoint(XCoordinate=margin_tip_x, YCoordinate=0, ZCoordinate=margin_height)

# ----
# cap control points
cap_top_tip = ConstructPoint(XCoordinate=0, YCoordinate=0, ZCoordinate=height)
cap_bowl_smoothness = ConstructPoint(XCoordinate=evaluate_2, YCoordinate=0, ZCoordinate=height)
steepness_min_width = ConstructPoint(XCoordinate=evaluate, YCoordinate=0, ZCoordinate=eval)
max_width = ConstructPoint(XCoordinate=min_of_cap_width_is_stem_width, YCoordinate=0, ZCoordinate=margin_height)

growth_factor = GrowthFactor(
    G_9=cap_top_tip,
    G_10=cap_bowl_smoothness,
    G_4=steepness_min_width,
    G_8=max_width,
    G_2=curly_outer,
    num=shape_factor,
    G=curly_middle,
    G_3=curly_inner,
    G_5=pt_3,
    G_6=pt,
    G_7=pt_2)  # -> gsqrt, gsqrt_2, gx, gsqr, gsqr_3, gsqr_2, gsqr_4, gsqr_5, gx_2, gx_3

# ----
# gill randomness params for amit (not in serial#)
number_slider_11 = Slider(0.645, range=0..1)
number_slider_12 = Slider(535, range=10..1000)
number_slider_13 = Slider(0.981, range=0..1)

cap_bottom_points = Merge(Data1=growth_factor.gsqr_5, Data2=growth_factor.gx_2, Data3=growth_factor.gx_3)
curl_points = Merge(Data1=growth_factor.gsqr_3, Data2=growth_factor.gsqr_2, Data3=growth_factor.gsqr_4)  # -> flatten(Result)
top_of_cap_points = Merge(Data1=growth_factor.gsqrt, Data2=growth_factor.gsqrt_2, Data3=growth_factor.gx, Data4=growth_factor.gsqr)
stem_points = Merge(Data1=top_section_2, Data2=mid_section, Data3=bottom_section, Data4=bottom_trim)
merge = Merge(Data1=curl_points, Data2=growth_factor.gsqr_5)  # -> flatten(Result)

concat_4 = Concatenate(FragmentA=number_slider_12, FragmentB=";", FragmentC=number_slider_13, FragmentD=";", FragmentE=number_slider_11)
concat_5 = Concatenate(
    FragmentA="hex: ",
    FragmentA_2=serial_no_hex_calculator.hex,
    FragmentB=" | sliders: ",
    FragmentC=sliders_data,
    FragmentA_3=" | gills: ",
    FragmentA_4=concat_4)
python = FileCreator(name=concat_2, ext=desired_file_extension, lines=concat_5, append=bake)  # -> out; inputs lines: list, write: Boolean
# ---------- python: Python ----------
"""
Creates a file with a given ndame and extension.
    Inputs:
        name: Desired file name.
        ext: Desired file extension.
        lines: Text to write.
        write: Set to True to write.
"""

# Stephen P. Maher /  2015

ghenv.Component.Name = "File Creator"

import Grasshopper as gh
import os

#gh_path = ghdoc.Path # Get GH file path
#file = os.path.dirname(os.path.realpath(gh_path)) # Get GH file directory to save to


if "." not in ext: ext = "." + ext
else: pass

#if os.path.exists(file) == False: # Test if file already exists; if it doesn't, proceed
#    file = name + ext # Set file name and extension
#if os.path.exists(file) == True: # If it does exists, follow the next steps
#    file_count = len([f for f in os.walk(".").next()[2] if f[-4:] == ext]) # Find all files #with the same extension
#    file = name + "_" + str(file_count) + ext # Add the number to the new file name as a #differentiator

file = name + ext

if write:
    filePath = open(file, "w") # Open the file
    for line in lines: # Iterate through lines
        filePath.write( line + "\n") # Write separate lines
        counter = counter + 1
    filePath.close() # Close the file
elif append == True: # If file has data and 'append' set to True and 'overwrite set to False  continue
    filePath = open(file, "a") # Open the file and 'append' document
    for line in lines: # Iterate through lines
        filePath.write("\n" + line) # Write separate lines
    filePath.close() # Close the file
else:
    msg = "Set 'write' to True."
    ghenv.Component.AddRuntimeMessage(gh.Kernel.GH_RuntimeMessageLevel.Warning, msg)
# ---------- end python ----------
panel_3 = Panel(concat_5)

# ----
# Tilt the Bake
panel_4 = Panel(height)
cluster = Cluster(C=panel_4, send=tilt_my_mushroom, A=amount_of_tilt, B=panel_4)

# ----
# OneCurve
merge_2 = Merge(Data1=top_of_cap_points, Data2=curl_points, Data3=cap_bottom_points, Data4=stem_points)
nurbs = NurbsCurve(Vertices=merge_2, Degree=3, Periodic=False)  # -> Curve, Length, Domain
ln = Line(StartPoint=cap_top_tip, EndPoint=Point(0, 0, 0))
gills = Gills(
    C=nurbs.Curve,
    A=cap_height,
    A_2=growth_factor.gsqrt,
    B=top_section_2,
    gillrand=number_slider_13,
    gillrand_2=number_slider_11,
    gill_density=number_slider_12)  # -> C_2, gill_curve_4, C_3, gill_curve_5, R
revsrf = Revolution(Curve=nurbs.Curve, Axis=ln, Domain=Domain(0, 6.283185307))

# ----
# merge and order surfaces
splitting_circles = Merge(Data1=gills.C_2, Data2=gills.C_3)
srfsplit = SurfaceSplit(Surface=revsrf, Curves=splitting_circles)
stem = ListItem(List=srfsplit, Index=1, Wrap=True)
cap = ListItem(List=srfsplit, Index=0, Wrap=True)
rulesrf = RuledSurface(CurveA=gills.gill_curve_4, CurveB=gills.C_2)
gills_2 = Loft(Curves=gills.R, Options={Adjust=False, Closed=False, LoftEnds=0, LoftSimp=0, LoftType=0, Rebuild=10, Refit=0.01})
rulesrf_2 = RuledSurface(CurveA=gills.gill_curve_5, CurveB=gills.C_3)
merge_3 = Merge(Data1=cap, Data2=rulesrf, Data3=gills_2, Data4=rulesrf_2, Data5=stem)
brepjoin = BrepJoin(Breps=merge_3)  # -> Breps, Closed

# ----
# Mushroom Object
brepmushroom = CapHoles(Brep=brepjoin.Breps)
scale = Scale(Geometry=brepmushroom, Center=Point(0, 0, 0), Factor=size_factor)  # -> Geometry, Transform

save = ObjectSave(
    BakeToggle=bake,
    FileDirectory=file_name,
    FileName=concat_3,
    GeometryObjects=scale.Geometry,
    Layer="GH_Export",
    ObjectName="GH_Obj",
    ObjectColor=RGB(255, 255, 255),
    LayerColor=RGB(255, 255, 255))

# ==== cluster Cluster
fragment_a = FragmentA("0,")
C = ClusterInput()
A = ClusterInput()
B = ClusterInput()
concat = Concatenate(FragmentA=fragment_a, FragmentB=fragment_a, FragmentC=C)
concat_2 = Concatenate(FragmentA=A, FragmentD=",0,", FragmentB=B)
panel = Panel(",0 ")
concat_3 = Concatenate(FragmentA="'_SelNone '_SelPolysrf Bend 0 ", FragmentC=concat, FragmentE=" ", FragmentD=concat_2, FragmentB=" Enter")
panel_2 = Panel(concat_3)
send = ClusterInput()
rhcom = RhinoCommand(SendCommandToggle=send, CommandString=panel_2)

# ==== cluster Archimedes
A = ClusterInput()
N = ClusterInput()
multiplication = Multiplication(A=A, B=2.718281828)
series = Series(Start=1, Step=N, Count=multiplication)
expression = Expression(t=series, Expression="t*cos(t)")
expression_2 = Expression(t=series, Expression="t*sin(t)")
A_2 = ClusterInput()
A_3 = ClusterInput()
margin_tip_x = Addition(A=A_2, B=expression)
margin_tip_z = Addition(A=A_3, B=expression_2)
pt = ConstructPoint(XCoordinate=margin_tip_x, YCoordinate=0, ZCoordinate=margin_tip_z)
curve_from_points = Interpolate(Vertices=pt, Degree=3, Periodic=False, KnotStyle=1)  # -> Curve, Length, Domain
A_4 = ClusterInput()
division = Division(A=A_4, B=Slider(7, range=0..10))
_3_points_of_curlyness = Integer(3)
series_2 = Series(Start=0.1, Step=division, Count=_3_points_of_curlyness)
panel = Panel(series_2)
eval = EvaluateCurve(Curve=reparameterize(curve_from_points.Curve), Parameter=series_2)  # -> Point, Tangent, Angle
P = ClusterOutput(eval.Point)

# ==== cluster SerialNoHexCalculator
T = ClusterInput()
rep = ReplaceText(Text=T, Find=".0", RecursiveReplace=False)
panel = Panel(rep)
cleanserial = ClusterOutput(rep)
split = TextSplit(Text=panel, Separators=";")
item = ListItem(List=split, Index=4, Wrap=True)
item_2 = ListItem(List=split, Index=5, Wrap=True)
item_3 = ListItem(List=split, Index=0, Wrap=True)
item_4 = ListItem(List=split, Index=1, Wrap=True)
item_5 = ListItem(List=split, Index=2, Wrap=True)
item_6 = ListItem(List=split, Index=3, Wrap=True)
c_script = CSharpScript(x=item)  # -> out, A
# ---------- c_script: C# ----------
                                                    //Reflect(x);

// Convert grasshopper object to string
string strX = x.ToString();

// Store integer x
int intValueX = Convert.ToInt32(strX);
//A = intValueX;

// Convert integer x as a hex in a string variable
string hexValue = intValueX.ToString("X");
A =hexValue;

return;
# ---------- c_script: C# additional code ----------
  //Return a BoundingBox that contains all the geometry you are about to draw.
  public override BoundingBox ClippingBox
  {
    get
    {
      return BoundingBox.Empty;
    }
  }

  //Draw all meshes in this method.
  public override void DrawViewportMeshes(IGH_PreviewArgs args)
  {
  }

  //Draw all wires and points in this method.
  public override void DrawViewportWires(IGH_PreviewArgs args)
  {
  }



  /// <summary>
  /// This method will be called once every solution, before any calls to RunScript.
  /// </summary>
  public override void BeforeRunScript()
  { }
  /// <summary>
  /// This method will be called once every solution, after any calls to RunScript.
  /// </summary>
  public override void AfterRunScript()
  { }
# ---------- end c_script ----------
c_script_2 = CSharpScript(x=item_2)  # -> out, A; same code as c_script
c_script_3 = CSharpScript(x=item_3)  # -> out, A
# ---------- c_script_3: C# ----------
                                                //Reflect(x);

// Convert grasshopper object to string
string strX = x.ToString();

// Store integer x
int intValueX = Convert.ToInt32(strX);
//A = intValueX;

// Convert integer x as a hex in a string variable
string hexValue = intValueX.ToString("X");
A =hexValue;

return;
# ---------- c_script_3: C# additional code ----------
  //Return a BoundingBox that contains all the geometry you are about to draw.
  public override BoundingBox ClippingBox
  {
    get
    {
      return BoundingBox.Empty;
    }
  }

  //Draw all meshes in this method.
  public override void DrawViewportMeshes(IGH_PreviewArgs args)
  {
  }

  //Draw all wires and points in this method.
  public override void DrawViewportWires(IGH_PreviewArgs args)
  {
  }



  /// <summary>
  /// This method will be called once every solution, before any calls to RunScript.
  /// </summary>
  public override void BeforeRunScript()
  { }
  /// <summary>
  /// This method will be called once every solution, after any calls to RunScript.
  /// </summary>
  public override void AfterRunScript()
  { }
# ---------- end c_script_3 ----------
c_script_4 = CSharpScript(x=c_script_3.A)  # -> out, A
# ---------- c_script_4: C# ----------
                                                        //Reflect(x);

// Convert from hex to int
string hexValue = x.ToString();

int intAgain = int.Parse(hexValue, System.Globalization.NumberStyles.HexNumber);
A = intAgain;

return;
# ---------- c_script_4: C# additional code ----------
  //Return a BoundingBox that contains all the geometry you are about to draw.
  public override BoundingBox ClippingBox
  {
    get
    {
      return BoundingBox.Empty;
    }
  }

  //Draw all meshes in this method.
  public override void DrawViewportMeshes(IGH_PreviewArgs args)
  {
  }

  //Draw all wires and points in this method.
  public override void DrawViewportWires(IGH_PreviewArgs args)
  {
  }



  /// <summary>
  /// This method will be called once every solution, before any calls to RunScript.
  /// </summary>
  public override void BeforeRunScript()
  { }
  /// <summary>
  /// This method will be called once every solution, after any calls to RunScript.
  /// </summary>
  public override void AfterRunScript()
  { }
# ---------- end c_script_4 ----------
c_script_5 = CSharpScript(x=item_4)  # -> out, A; same code as c_script
c_script_6 = CSharpScript(x=item_5)  # -> out, A; same code as c_script
c_script_7 = CSharpScript(x=item_6)  # -> out, A; same code as c_script
len = TextLength(Text=c_script_3.A)
len_2 = TextLength(Text=c_script_5.A)
len_3 = TextLength(Text=c_script_6.A)
len_4 = TextLength(Text=c_script.A)
len_5 = TextLength(Text=c_script_2.A)
ins = InsertItems(List=len, Item=len_2, Indices=1, Wrap=True)
ins_2 = InsertItems(List=ins, Item=len_3, Indices=2, Wrap=True)
ins_3 = InsertItems(List=ins_2, Item=len_4, Indices=3, Wrap=True)
ins_4 = InsertItems(List=ins_3, Item=len_5, Indices=4, Wrap=True)  # -> flatten(Lengths)
panel_2 = Panel(ins_4)
concat = Concatenate(
    FragmentA=c_script_3.A,
    FragmentB=c_script_5.A,
    FragmentC=c_script_6.A,
    FragmentF=c_script_7.A,
    FragmentD=c_script.A,
    FragmentE=c_script_2.A)
hex = ClusterOutput(concat)

# ==== cluster GrowthFactor
num = ClusterInput()
num_2 = Number(num)
expression = Expression(x=num_2, Expression="x^⅓")
G = ClusterInput()
G_2 = ClusterInput()
G_3 = ClusterInput()
G_4 = ClusterInput()
G_5 = ClusterInput()
G_6 = ClusterInput()
G_7 = ClusterInput()
G_8 = ClusterInput()
G_9 = ClusterInput()
G_10 = ClusterInput()
sqr = Square(Value=num_2)
scale = Scale(Geometry=G, Center=Point(0, 0, 0), Factor=expr("x^2", num_2))  # -> Geometry, Transform
scale_2 = Scale(Geometry=G_2, Center=Point(0, 0, 0), Factor=expr("x^2", num_2))  # -> Geometry, Transform
scale_3 = Scale(Geometry=G_3, Center=Point(0, 0, 0), Factor=expr("x^2", num_2))  # -> Geometry, Transform
scale_4 = Scale(Geometry=G_5, Center=Point(0, 0, 0), Factor=expr("x^2", num_2))  # -> Geometry, Transform
scale_5 = Scale(Geometry=G_6, Center=Point(0, 0, 0), Factor=num_2)  # -> Geometry, Transform
scale_6 = Scale(Geometry=G_7, Center=Point(0, 0, 0), Factor=num_2)  # -> Geometry, Transform
scale_7 = Scale(Geometry=G_8, Center=Point(0, 0, 0), Factor=sqr)  # -> Geometry, Transform
scale_8 = Scale(Geometry=G_9, Center=Point(0, 0, 0), Factor=expression)  # -> Geometry, Transform
scale_9 = Scale(Geometry=G_4, Center=Point(0, 0, 0), Factor=num_2)  # -> Geometry, Transform
scale_10 = Scale(Geometry=G_10, Center=Point(0, 0, 0), Factor=expression)  # -> Geometry, Transform
gx = ClusterOutput(scale_9.Geometry)
gx_2 = ClusterOutput(scale_5.Geometry)
gx_3 = ClusterOutput(scale_6.Geometry)
gsqr = ClusterOutput(scale_7.Geometry)
gsqrt = ClusterOutput(scale_8.Geometry)
gsqr_2 = ClusterOutput(scale.Geometry)
gsqrt_2 = ClusterOutput(scale_10.Geometry)
gsqr_3 = ClusterOutput(scale_2.Geometry)
gsqr_4 = ClusterOutput(scale_3.Geometry)
gsqr_5 = ClusterOutput(scale_4.Geometry)

# ==== cluster Gills
gillrand = ClusterInput()
gillrand_2 = ClusterInput()
gill_density = ClusterInput()
A = ClusterInput()
A_2 = ClusterInput()
B = ClusterInput()
C = ClusterInput()

dom = ConstructDomain(DomainStart=Slider(5.648, range=0..10), DomainEnd=Slider(9.02, range=0..10))
subcrv = SubCurve(BaseCurve=C, Domain=dom)

curvepoint = PointOnCurve(subcrv, parameter=1)
curvepoint_2 = PointOnCurve(subcrv, parameter=0)
curvepoint_3 = PointOnCurve(subcrv, parameter=0.536)

# ----
# gills as point on curve
gill_density_2 = Slider(102, range=0..200)
gill_height_based_on_cap_height = Division(A=A, B=7)
dist = Distance(PointA=A_2, PointB=B)  # -> expr("x/9", Distance)
min = Minimum(A=gill_height_based_on_cap_height, B=dist)

pdecon = Deconstruct(Point=curvepoint_2)  # -> XComponent, YComponent, ZComponent
pt = ConstructPoint(XCoordinate=0, YCoordinate=0, ZCoordinate=pdecon.ZComponent)
xy = XYPlane(Origin=pt)
cir = Circle(Plane=xy, Radius=pdecon.XComponent)
gill_curve = GillCurve(crv=cir, gill_height=min, gill_density=gill_density, N=gillrand)

pdecon_2 = Deconstruct(Point=curvepoint_3)  # -> XComponent, YComponent, ZComponent
pt_2 = ConstructPoint(XCoordinate=0, YCoordinate=0, ZCoordinate=pdecon_2.ZComponent)
xy_2 = XYPlane(Origin=pt_2)
cir_2 = Circle(Plane=xy_2, Radius=pdecon_2.XComponent)
gill_curve_2 = GillCurve(crv=cir_2, gill_height=min, gill_density=gill_density, N=gillrand)

pdecon_3 = Deconstruct(Point=curvepoint)  # -> XComponent, YComponent, ZComponent
pt_3 = ConstructPoint(XCoordinate=0, YCoordinate=0, ZCoordinate=pdecon_3.ZComponent)
xy_3 = XYPlane(Origin=pt_3)
cir_3 = Circle(Plane=xy_3, Radius=pdecon_3.XComponent)
gill_curve_3 = GillCurve(crv=cir_3, gill_height=min, gill_density=gill_density, N=gillrand_2)

C_2 = ClusterOutput(cir)
C_3 = ClusterOutput(cir_3)
gill_curve_4 = ClusterOutput(gill_curve)
gill_curve_5 = ClusterOutput(gill_curve_3)

merge = Merge(Data1=gill_curve, Data2=gill_curve_2, Data3=gill_curve_3)

R = ClusterOutput(merge)

# ==== cluster GillCurve
crv = ClusterInput()
gill_density = ClusterInput()
gill_height = ClusterInput()
crv_2 = Curve(crv)
division = Division(GillDensity=gill_density, B=2)
reb = RebuildCurve(Curve=crv_2, GillDensity=gill_density, Tangents=False)
round = Round(Number=division)  # -> Nearest, Floor, Ceiling
cp = ControlPoints(Curve=reb)  # -> Points, Weights, Knots
addition = Addition(A=round.Ceiling, B=1)
series = Series(Start=0, Step=2, Count=addition)
concat = Concatenate(FragmentA="0,0,", GillHeight=gill_height)
item = ListItem(List=cp.Points, Index=series, Wrap=True)
vec2pt = Vector2Pt(PointA=Point(0, 0, 0), PointB=concat, Unitize=False)  # -> Vector, Length
series_2 = Series(Start=1, Step=2, Count=addition)
move = Move(Geometry=item, Motion=vec2pt.Vector)  # -> Geometry, Transform
item_2 = ListItem(List=cp.Points, Index=series_2, Wrap=True)
path_mapper = PathMapper(move.Geometry, source="{a;b}", target="{a}")
shift = ShiftList(List=item_2, Shift=-1, Wrap=False)
path_mapper_2 = PathMapper(shift, source="{a;b;c}", target="{a}")
series_3 = Series(Start=1, Step=1, Count=round.Ceiling)
path_mapper_3 = PathMapper(series_3, source="{a;b}", target="{a}")
ins = InsertItems(List=path_mapper, Item=path_mapper_2, Indices=path_mapper_3, Wrap=False)
path_mapper_4 = PathMapper(ins, source="{a;b}", target="{a}")
tag = TextTag(Location=ins, Text=ins, Colour=RGB(27, 245, 255))
panel = Panel(path_mapper_4)
number_slider = Slider(0.751, range=0..1)
N = ClusterInput()
cluster = Cluster_2(pt=panel, N=N, B=N)
intcrv = Interpolate(Vertices=cluster, Degree=3, Periodic=False, KnotStyle=1)  # -> GillCurve, Length, Domain
gill_curve = ClusterOutput(intcrv.GillCurve)

# ==== cluster Cluster_2
B = ClusterInput()
N = ClusterInput()
subtraction = Subtraction(A=0, B=B)
pt = ClusterInput()
bnd = Bounds(Numbers=[subtraction, N])
pt_2 = Point(pt)
lng = ListLength(List=pt_2)
random = Random(Range=bnd, Number=lng, Seed=3)
random_2 = Random(Range=bnd, Number=lng, Seed=4)
random_3 = Random(Range=bnd, Number=lng, Seed=2)
pt_3 = ConstructPoint(XCoordinate=random_3, YCoordinate=random, ZCoordinate=random_2)
move = Move(Geometry=pt_2, Motion=pt_3)  # -> Geometry, Transform
G = ClusterOutput(move.Geometry)
